# Grasshopper definition Coloredmesh.gh (Grasshopper 0.9.56)
# plug-ins: Kangaroo Components, Weaverbird, Static Repulsion of Spheres

mesh = Mesh(<mesh referenced from the Rhino model>)
wbvertices = WeaverbirdsVerticesComponent(MeshClosedPolylinesGroup=mesh, Weld=True)
range = Range(Domain=Domain(0, 255), Steps=440)
rgb = ColourRGB(Alpha=255, Red=range, Green=range, Blue=range)
mspray = MeshSpray(Mesh=mesh, Points=wbvertices, Colours=rgb, SprayMode=11)
P = Points([Point(-116, 76, 0), Point(-124, 16, 0), Point(-115, 2, 0), Point(-100, -41, 0), Point(-85, -38, 0), Point(-67, -35, 0)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])
duppt = RemoveDuplicatePts(Points=P, Tolerance=0.01)
repulse = SphereRepulsion(Points=duppt, Radius=10, Mesh=mspray, Force=5, Reset=Toggle(False))  # -> Sphere, Points, Acceleration, Velocity, Planes
timer = Timer(TimerInterval=20, Target=repulse)
pt = Point(repulse.Points)
