# Grasshopper definition Colouredmesh4.gh (Grasshopper 0.9.56)
# plug-ins: Weaverbird, Static Repulsion of Spheres

mesh = Mesh(<mesh referenced from the Rhino model>)
wbvertices = WeaverbirdsVerticesComponent(MeshClosedPolylinesGroup=mesh, Weld=False)
dist = Distance(PointA=Point(0, 0, 0), PointB=wbvertices)
sort = SortList(Keys=dist)  # -> reverse(Keys), ValuesA
pop2d = Populate2D(Region={Plane=PlaneXY(-500, -500, 0), Size=Domain2(u=0..1000, v=0..1000)}, Count=100, Seed=1)
item = ListItem(List=sort.Keys, Index=0, Wrap=True)
lng = ListLength(List=pop2d)
dom = ConstructDomain(DomainStart=Slider(22, range=0..100), DomainEnd=Slider(41, range=0..100))
division = Division(A=255, B=item)
random = Random(Range=dom, Number=lng, Seed=2)
multiplication = Multiplication(A=dist, B=division)
rgb = ColourRGB(Alpha=255, Red=multiplication, Green=multiplication, Blue=multiplication)
mspray = MeshSpray(Mesh=mesh, Points=wbvertices, Colours=rgb, SprayMode=11)
timer = Timer(TimerInterval=20, Target=repulse)
repulse = RepulsionOfPointsOnMesh(
    Points=pop2d,
    Radius=random,
    Mesh=mesh,
    Damping=0.8,
    Force=Slider(983, range=0..1000),
    Reset=Toggle(False),
    Colour=rgb,
    ColourImportance=1)  # -> Points, Acceleration, Velocity, Brigthnesses
sph = Sphere(Base=repulse.Points, Radius=random)
