# Grasshopper definition CurvedMesh.gh (Grasshopper 0.9.56)
# plug-ins: Weaverbird, Static Repulsion of Spheres

mesh = Mesh(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)
wbcatmullclark = WeaverbirdsCatmullClarkSubdivision(MeshCurves=mesh, Level=3, SmoothNakedEdges=1)
facen = FaceNormals(Mesh=wbcatmullclark)  # -> Centers, Normals
timer = Timer(TimerInterval=100, Target=repulse)
points = PointList(Points=facen.Centers, Tags=True, Lines=False)
repulse = SphereRepulsion(
    Points=[Point(44.23736127, -11.02227176, 0), Point(12.89773798, 25.91371283, 0), Point(12.89773798, 3.528267621, 0)],
    Radius=10,
    Mesh=wbcatmullclark,
    Force=-15,
    Reset=Toggle(True))  # -> Sphere, Points
