# Grasshopper definition HoledMesh and AngledMesh.gh (Grasshopper 0.9.56)
# plug-ins: Static Repulsion of Spheres

M = Mesh(<mesh referenced from the Rhino model>)
facen = FaceNormals(Mesh=M)  # -> Centers, Normals
line = LineSDL(Start=facen.Centers, Direction=facen.Normals, Length=200)
weld = WeldMesh(Mesh=M, Angle=3.141592654)
M_2 = Mesh(<mesh referenced from the Rhino model>)
weld_2 = WeldMesh(Mesh=M_2, Angle=3.141592654)
repulse = SphereRepulsion(
    Points=[Point(102.4551769, 46.8855103, 0), Point(124.0694465, 46.8855103, 0)],
    Radius=10,
    Mesh=weld,
    Force=15,
    Reset=Toggle(False))  # -> Sphere, Points, Acceleration, Velocity, Planes
timer = Timer(TimerInterval=50, Target=repulse)
repulse_2 = SphereRepulsion(
    Points=[Point(-66.73084501, 524.897463, 0), Point(-66.73084501, 529.8484224, 0), Point(-2.368373864, 529.8484224, 0), Point(-2.368373864, 529.8484224, 0), Point(64.46957695, 529.8484224, 0), Point(94.17533286, 529.8484224, 0)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],
    Radius=10,
    Mesh=weld_2,
    Force=50,
    Reset=Toggle(True))  # -> Sphere, Points, Acceleration, Velocity, Planes; disabled
timer_2 = Timer(TimerInterval=20, Target=repulse_2)
end = EndPoints(Curve=repulse.Velocity)  # -> Start, End
end_2 = EndPoints(Curve=repulse_2.Acceleration)  # -> Start, End
scale = Scale(Geometry=repulse.Velocity, Center=end.Start, Factor=25)  # -> Geometry, Transform
scale_2 = Scale(Geometry=repulse_2.Acceleration, Center=end_2.Start, Factor=1000)  # -> Geometry, Transform
pipe = Pipe(Curve=scale.Geometry, Radius=1, Caps=0)
brep = Brep(repulse_2.Sphere)
pipe_2 = Pipe(Curve=scale_2.Geometry, Radius=1, Caps=0)
len = Length(Curve=repulse_2.Velocity)
ma = MassAddition(Input=len)  # -> Result, PartialResults
rec = DataRecorder(ma.Result, RecordData=True, DataLimit=-10)
partition = PartitionList(List=rec, Size=50)
avr = Average(Input=partition)
flip = FlipMatrix(Data=avr)
graph = QuickGraph(flip)
graph_2 = QuickGraph(rec)
