# Grasshopper definition Circle.ghx (Grasshopper 0.9.56)
# plug-ins: Static Repulsion of Spheres

pt = Point([Point(-3369.878561, -1662.643566, 0), Point(-1749.229412, -1662.643566, 0), Point(-918.6467231, -1662.643566, 0), Point(-918.6467231, -2837.6142, 0), Point(-2184.778871, -3273.163659, 0), Point(-2863.425702, -2868.001371, 0), Point(-2802.651359, -2239.999826, 0), Point(-2306.327557, -1946.257167, 0), Point(-2144.262642, -862.4480489, 0)])
pt_2 = Point(Point(-543.8716073, -578.8344477, 0))
circle = CircleCNR(Center=pt_2, Normal=Vector(0, 0, 1), Radius=Slider(1000, range=0..1000))
divide = DivideCurve(Curve=circle, Count=10, Kinks=False)  # -> Points, Tangents, Parameters
flatten = FlattenTree(Tree=[pt_2, divide.Points], Path="{0}")
repulse = SphereRepulsion(Points=flatten, Radius=Slider(100, range=0..100), Translation=Slider(12, range=0..100), Reset=True)
