# Grasshopper definition Coloredmesh3.gh (Grasshopper 0.9.56)
# plug-ins: TestOfVertices, Static Repulsion of Spheres

pop2d = Populate2D(
    Region={Plane=PlaneXY(-135.7904696, -71.41899096, 0), Size=Domain2(u=0..226.1948131, v=0..184.1094171)},
    Count=200,
    Seed=1)
M = Mesh(<mesh referenced from the Rhino model>)
msphere = MeshSphere(Base=PlaneXY(0, 0, 0), Radius=Slider(200, range=0..1000), UCount=10, VCount=20)
lng = ListLength(List=pop2d)
weld = WeldMesh(Mesh=msphere, Angle=3.141592654)
verticestest = TestMyVertices(Mesh=weld)
lng_2 = ListLength(List=verticestest)
range = Range(Domain=Domain(0, 255), Steps=expr("n-1", lng_2))
random = Random(Range=Domain(20, 25), Number=lng, Seed=2)
rgb = ColourRGB(Alpha=255, Red=range, Green=range, Blue=range)
mspray = MeshSpray(Mesh=weld, Points=verticestest, Colours=rgb, SprayMode=11)
timer = Timer(TimerInterval=20, Target=repulse)
repulse = SphereRepulsion(
    Points=pop2d,
    Radius=random,
    Mesh=weld,
    Damping=0.6,
    Force=100,
    Reset=Toggle(False),
    Colour=rgb,
    ColourImportance=Slider(0.93, range=0..1))  # -> Points, Acceleration, Velocity, Brigthnesses, Vertices
panel = Panel(repulse.Brigthnesses)
X = UnitX(Factor=Slider(-1, range=-500..700))
Y = UnitY(Factor=Slider(-1, range=-200..700))
line = Line(repulse.Velocity)
flip = FlipMatrix(Data=repulse.Brigthnesses)
addition = Addition(A=Y, B=X)
move = Move(Motion=addition)  # -> Geometry, Transform
sph = Sphere(Base=repulse.Points, Radius=random)
end = EndPoints(Curve=line)  # -> Start, End
rec = DataRecorder(flip, RecordData=True, DataLimit=-10)
graph = QuickGraph(rec)
scale = Scale(Geometry=line, Center=end.Start, Factor=Slider(100, range=0..100))  # -> Geometry, Transform
