# Grasshopper definition Mesh for RadiusTest.gh (Grasshopper 0.9.56)
# plug-ins: Weaverbird, Static Repulsion of Spheres

pt = Point([Point(-65.31207669, 45.36075668, 0), Point(-56.01725489, 19.11655398, 0), Point(-56.01725489, 2.167173061, 0), Point(-47.26918732, -9.861419846, 0), Point(-47.26918732, -9.314665623, 0), Point(-47.26918732, -9.314665623, 0)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])
M = Mesh(<mesh referenced from the Rhino model>)
pop2d = Populate2D(
    Region={Plane=PlaneXY(-40.00457878, -14.71462111, 0), Size=Domain2(u=0..120.4265682, v=0..75.15342224)},
    Count=50,
    Seed=1)
lng = ListLength(List=pop2d)
wbcatmullclark = WeaverbirdsCatmullClarkSubdivision(MeshCurves=M, Level=2, SmoothNakedEdges=1)
random = Random(Range=Domain(2, 15), Number=lng, Seed=2)
wbcatmullclark_2 = WeaverbirdsCatmullClarkSubdivision(MeshCurves=wbcatmullclark, Level=1, SmoothNakedEdges=1)
weld = WeldMesh(Mesh=wbcatmullclark_2, Angle=3.141592654)
timer = Timer(TimerInterval=20, Target=repulse)  # disabled
repulse = SphereRepulsion(Points=pop2d, Radius=random, Mesh=weld, Force=1, Reset=Toggle(False))  # -> Sphere, Points, Acceleration, Velocity, Planes, Brigthnesses
msphere = MeshSphere(Base=repulse.Points, Radius=random, UCount=7, VCount=7)
len = Length(Curve=repulse.Velocity)
flip = FlipMatrix(Data=repulse.Points)
ma = MassAddition(Input=len)  # -> Result, PartialResults
msplit = MeshSplit(Mesh=wbcatmullclark_2, Splitters=msphere)
rec = DataRecorder(ma.Result, RecordData=True, DataLimit=-10)
wbvertices = WeaverbirdsVerticesComponent(MeshClosedPolylinesGroup=msplit, Weld=True)
cps = ClosestPoints(Point=flip, Cloud=repulse.Points, Count=5)  # -> ClosestPoint, CPIndex, Distance
lng_2 = ListLength(List=wbvertices)
item = ListItem(List=cps.ClosestPoint, Index=1, Wrap=True)
flip_2 = FlipMatrix(Data=lng_2)
sort = SortList(Keys=flip_2, ValuesA=msplit)  # -> Keys, ValuesA
rev = ReverseList(List=sort.ValuesA)
item_2 = ListItem(List=rev, Index=0, Wrap=True)
ln = Line(StartPoint=flip, EndPoint=cps.ClosestPoint)
dist = Distance(PointA=item, PointB=flip)
flip_3 = FlipMatrix(Data=dist)
avr = Average(Input=flip_3)
rec_2 = DataRecorder(avr, RecordData=True, DataLimit=-10)
graph = QuickGraph(rec_2)
graph_2 = QuickGraph(rec)
panel = Panel(ma.Result)
bar_graph = BarGraph(dist, BarColor=RGB(255, 0, 90))
